# Grasshopper definition FUN FACADE.ghx (Grasshopper 1.0.8)

number_slider = Slider(1, range=0..1)
unit_y = UnitY(Factor=1)
curve = Curve(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)
point = Point(Point(0, 0, 0))
line_sdl = LineSDL(Start=point, Direction=unit_y, Length=Slider(0.9, range=0..10))
unit_z = UnitZ(Factor=Slider(4, range=0..10))
curve_middle = CurveMiddle(Curve=line_sdl)
move = Move(Geometry=line_sdl, Motion=unit_z)  # -> Geometry, Transform
rotate_3d = Rotate3D(Geometry=line_sdl, Angle=degrees(Slider(0, range=0..100)), Center=curve_middle, Axis=Vector(0, 0, 1))  # -> Geometry, Transform
curve_middle_2 = CurveMiddle(Curve=move.Geometry)
rotate_3d_2 = Rotate3D(Geometry=move.Geometry, Angle=degrees(Slider(90, range=0..100)), Center=curve_middle_2, Axis=Vector(0, 0, 1))  # -> Geometry, Transform
unit_y_2 = UnitY(Factor=Slider(1, range=0..1))
loft = Loft(
    Curves=[rotate_3d_2.Geometry, rotate_3d.Geometry],
    Options={Adjust=False, Closed=False, LoftEnds=0, LoftSimp=0, LoftType=0, Rebuild=10, Refit=0.01})
linear_array = LinearArray(Geometry=loft, Direction=unit_y_2, Count=Slider(10, range=0..10))  # -> graft(Geometry), Transform
